# Grasshopper definition ImportToGrasshopper_Final_15-04-2021.ghx (Grasshopper 1.0.7)
# plug-ins: LunchBox

# ---- group: RH_IN:Input File Path
text = Text("D:\web-backend\src\middlewares\uploads\605325dcaef9542d3cb68dd4\606bf21bb5d1511878b94a22\Autocad_File.dwg")

# ----
# 1. Imporing file in Rhino
boolean_toggle = BooleanToggle(True)
ghpython_script = PythonScript(filePath=text, Import=boolean_toggle)  # -> out, result, fileName, fileDirectory, outputFilePath; inputs Import: Boolean
# ---------- ghpython_script: Python ----------
import rhinoscriptsyntax as rs
import scriptcontext as sc
import Rhino



def importToGrasshopper(filePath):
    print(filePath)
    if filePath:
        if filePath.endswith("\\"):
            print "Please input filePath"
            return False
    else:
        print "Please input filePath"
        return False

    # get fileType
    fileType = filePath.split('\\')[-1].split('.')[-1]

    print (fileType)
    # check the input data
    if fileType:
        if fileType.startswith("."):
            pass
        else:
            fileType = "." + fileType

        supportedFileTypes = [".3dm", ".3ds", ".sat", ".ai", ".dwg", ".dxf", ".dae", ".cd", ".x", ".emf", ".gf", ".pm", ".kmz", ".gts", ".igs", ".iges", ".udo", ".fbx", ".obj", ".csv", ".x_t", ".pdf", ".ply", ".txt", ".pov", ".raw", ".rib", ".skp", ".step", ".stl", ".tsm", ".tss", ".vda", ".wrl", ".vmrl", ".gdf", ".wmf", ".x3dv", ".xaml", ".xgl", ".zpr"]
        if fileType in supportedFileTypes:
            pass
        else:
            print "File type %s is not supported" % fileType
            return False
    else:
        print "Please input fileType"
        return False
    # geometryTypes functions
    #filePath = filePath.replace("\\","\\\\")
    commandString = "_-Import " + filePath + " _Enter _Enter"
    #print (commandString)
    rs.Command(commandString)
    #rs.Command("_-Import ")
    #rs.Command(filePath+" _Enter")
    #rs.Command("_Enter ")
    result = rs.LastCommandResult()
    commandName = rs.LastCommandName()
    print (commandName)
    print (result)
    if result == 0:
        print "File successfully imported from: %s" % (filePath)
        return True
    else:
        return False



if Import:
    fileName = filePath.split('\\')[-1].split('.')[0]+".3dm"
    fileDirectory = '\\'.join(filePath.split('\\')[:-1])+'\\'
    result = importToGrasshopper(filePath)
    if result:
        outputFilePath = filePath.split('.')[0]+".3dm"
    else:
        outputFilePath = None
# ---------- end ghpython_script ----------

# ----
# 2. Saving the imported file as .3dm
panel = Panel("curve")
object_save = ObjectSave(
    BakeToggle=ghpython_script.result,
    FileDirectory=ghpython_script.fileDirectory,
    FileName=ghpython_script.fileName,
    GeometryObjects=panel,
    Layer="GH_Export",
    ObjectName="GH_Obj",
    ObjectColor=RGB(255, 255, 255),
    LayerColor=RGB(255, 255, 255))

# ---- group: RH_OUT:Output File Path
txt = Text(ghpython_script.outputFilePath)
