# Grasshopper definition ImportToGrasshopper_Final_17-04-2021.ghx (Grasshopper 1.0.7)

# ---- group: RH_IN:Unit System
scale = Text("Meters")

# ---- group: RH_IN:Input File Path
text = Text("C:\Users\navashiva\Downloads\Autocad_File.dwg")

# ----
ghpython_script = GhPythonScript(filePath=text, unitSystem=scale)  # -> out, outputFilePath
# ---------- ghpython_script: Python ----------
__author__ = "navashiva"
__version__ = "2021.04.17"

import rhinoscriptsyntax as rs
import Rhino

headlessDoc = Rhino.RhinoDoc.CreateHeadless(None)
headlessDoc.Import(filePath)
if unitSystem == 'Meters':
    headlessDoc.AdjustModelUnitSystem(Rhino.UnitSystem.Meters,True)
response = headlessDoc.Write3dmFile(filePath.replace('.dwg','.3dm'),Rhino.FileIO.FileWriteOptions())
if response:
    outputFilePath = filePath.replace('.dwg','.3dm')
# ---------- end ghpython_script ----------

# ---- group: RH_OUT:Output File Path
txt = Text(ghpython_script.outputFilePath)
